# Grasshopper definition R1.Generating-Views-ver01.ghx (Grasshopper 1.0.7)
# plug-ins: SAM.Core.Grasshopper.Revit

panel = Panel("""RiserCLG
RiserHTG
RiserVNT
ICType
RefExhaust
RefSupply
SAM Model
NoPeople
Heating Load
Cooling Load""")
samcore_duplicateviewsbytemplatename = SAMCoreDuplicateViewsByTemplateName(
    _templateName_Source="00_Reference",
    _templateNames_Destination=panel,
    _viewTypes_="FloorPlan",
    _run=Toggle(True),
    SAM_ComponentVersion="1.0.1")
panel_2 = Panel(samcore_duplicateviewsbytemplatename)
