# Grasshopper definition R1c.GeneratingCustomViews_ver00.ghx (Grasshopper 1.0.7)
# plug-ins: Rhino.Inside for Autodesk Revit, SAM.Core.Grasshopper.Revit

trigger = Trigger(Interval=-1000, TimerInterval=1000, Target=query_views)
query_views = QueryViews(IsTemplate=True, IsAssembly=False, IsPrintable=False)
element_name = ElementName(Element=query_views)  # -> Element, Name
value_set_picker = ValueSetPicker(element_name.Name)
panel = Panel(value_set_picker)
boolean_toggle = BooleanToggle(False)
samcore_duplicateviewsbytemplatename = SAMCoreDuplicateViewsByTemplateName(
    _templateName_Source="00_Reference",
    _templateNames_Destination=panel,
    _viewTypes_="FloorPlan",
    _run=Button(),
    SAM_ComponentVersion="1.0.0",
    SAM_SAMVersion="v20210215.1")
panel_2 = Panel(samcore_duplicateviewsbytemplatename)
