# Grasshopper definition R2.Generating-Sheets-Dependat-Views_ver01.ghx (Grasshopper 1.0.7)
# plug-ins: Rhino.Inside for Autodesk Revit, SAM.Core.Grasshopper.Revit

panel = Panel("""Cooling Load
Heating Load""")
a0_template = Panel("725533")
a1_template = Panel("725518")
query_element = QueryElement(Id=a0_template)
panel_2 = Panel(query_element)
samcore_createsheets = SAMCoreCreateSheets(
    _referenceViewSheet=query_element,
    _templateNames=panel,
    _matchScopeBox_=Toggle(True),
    _run=Toggle(True),
    SAM_ComponentVersion="1.0.1")
element_name = ElementName(Element=samcore_createsheets)  # -> Element, Name
panel_3 = Panel(element_name.Name)
