# Grasshopper definition R2.GeneratingSheets_ver00.ghx (Grasshopper 1.0.7)
# plug-ins: Rhino.Inside for Autodesk Revit, SAM.Core.Grasshopper.Revit

a0_template = Panel("725533")
a1_template = Panel("725518")
panel = Panel("""Cooling Load
Heating Load""")
boolean_toggle = BooleanToggle(False)
query_element = QueryElement(Id=a0_template)
panel_2 = Panel(query_element)
samcore_createsheets = SAMCoreCreateSheets(
    _referenceViewSheet=query_element,
    _templateNames=panel,
    _matchScopeBox_=False,
    _run=Toggle(True),
    SAM_ComponentVersion="1.0.0",
    SAM_SAMVersion="v20210215.1")
element_name = ElementName(Element=samcore_createsheets)  # -> Element, Name
panel_3 = Panel(element_name.Name)
