# Grasshopper definition R2a.DeleteAllSheetsExceptOriginals_ver00.ghx (Grasshopper 1.0.7)
# plug-ins: SAM.Core.Grasshopper.Revit, Rhino.Inside for Autodesk Revit, Bifocals

model = ModelCategoriesPicker({"Air Systems": -2001008, "Air Terminals": -2008013, "Analysis Display Style": -2000304, "Analysis Results": -2000303, "Areas": -2003200, "Bridge Abutments": -2006130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}, selected="Sheets": -2003100)
category_filter = CategoryFilter(Categories=model, Inverted=False)
query_views = QueryViews(IsTemplate=False, IsAssembly=False, IsPrintable=True, Filter=category_filter)
element_passport = ElementPassport(Element=query_views)  # -> DocumentGUID, Document, UniqueID, Id
panel = Panel("""725518
725533
802983
805316
835480
1007139
1008572""")
text = Text(element_passport.Id)
member_index = MemberIndex(Set=text, Member=flatten(panel))  # -> flatten(Index), Count
cull_index = CullIndex(List=text, Indices=member_index.Index, Wrap=True)
panel_2 = Panel(cull_index)
integer = Integer(cull_index)
button = Button()
samcore_deleteelement = SAMCoreDeleteElement(_elements=integer, _run=Toggle(True), SAM_ComponentVersion="1.0.0", SAM_SAMVersion="v20210215.1")
