# Grasshopper definition R2c.GeneratingCustomSheets_ver00.ghx (Grasshopper 1.0.7)
# plug-ins: Rhino.Inside for Autodesk Revit, SAM.Core.Grasshopper.Revit

trigger = Trigger(Interval=-1000, TimerInterval=1000, Target=query_views)
query_views = QueryViews(IsTemplate=True, IsAssembly=False, IsPrintable=False)
element_name = ElementName(Element=query_views)  # -> Element, Name
value_set_picker = ValueSetPicker(element_name.Name)
panel = Panel(value_set_picker)
a1_template = Panel("725518")
a0_template = Panel("725533")
query_element = QueryElement(Id=a0_template)

# ---- group: if dependent view set True
boolean_toggle = BooleanToggle(True)

# ----
boolean_toggle_2 = BooleanToggle(False)

panel_2 = Panel(query_element)
samcore_createsheets = SAMCoreCreateSheets(
    _referenceViewSheet=graft(query_element),
    _templateNames=panel,
    _matchScopeBox_=boolean_toggle,
    _run=Button(),
    SAM_ComponentVersion="1.0.0",
    SAM_SAMVersion="v20210215.1")
element_name_2 = ElementName(Element=samcore_createsheets)  # -> Element, Name
panel_3 = Panel(element_name_2.Name)
