# Grasshopper definition R3.TagWalls-ver01.ghx (Grasshopper 1.0.7)
# plug-ins: SAM.Core.Grasshopper.Revit, Rhino.Inside for Autodesk Revit

# ---- group: Not Curtain Walls
sam_core_wallkind = SAMCoreWallKind(WallKind=1, SAM_ComponentVersion="1.0.0", SAM_SAMVersion="v20210215.1")
samcore_getwalls = SAMCoreGetWalls(_wallKinds=sam_core_wallkind, _inverted=Toggle(True), SAM_ComponentVersion="1.0.0", SAM_SAMVersion="v20210215.1")

# ---- group: Curtain
sam_core_wallkind_2 = SAMCoreWallKind(WallKind=1, SAM_ComponentVersion="1.0.0", SAM_SAMVersion="v20210215.1")
samcore_getwalls_2 = SAMCoreGetWalls(_wallKinds=sam_core_wallkind_2, _inverted=False, SAM_ComponentVersion="1.0.0", SAM_SAMVersion="v20210215.1")

# ----
number_slider = Slider(1, range=0..1)
_1_5_m_min_lentgt_for_tag = Panel("1.5")
anno_tag_sam_curtainwall = ElementTypePicker({"Anno_Tag_SAM_CurtainWall : Standard": "31a4f1de-43ed-48e5-952d-fe23d1d01058-6c0b39d8-0d37-4f43-8941-b826f64e1f9c-000cd85c"}, selected=[])
anno_tag_sam_wall = ElementTypePicker({"Anno_Tag_SAM_Wall : Standard": "31a4f1de-43ed-48e5-952d-fe23d1d01058-85bd20c8-aefd-4e77-9d94-d5590b09affa-000bd87f"}, selected=[])
getparam = GetElementParameter(Element=samcore_getwalls_2, ParameterKey="Length")
getparam_2 = GetElementParameter(Element=samcore_getwalls, ParameterKey="Length")
larger = LargerThan(FirstNumber=getparam, SecondNumber=_1_5_m_min_lentgt_for_tag)  # -> LargerThan, OrEqualTo
larger_2 = LargerThan(FirstNumber=getparam_2, SecondNumber=_1_5_m_min_lentgt_for_tag)  # -> LargerThan, OrEqualTo
element = Element(anno_tag_sam_wall)
element_2 = Element(anno_tag_sam_curtainwall)
element_passport = ElementPassport(Element=[element_2, element])  # -> DocumentGUID, Document, UniqueID, Id
dispatch = Dispatch(List=samcore_getwalls_2, DispatchPattern=larger.LargerThan)  # -> ListA, ListB
merge = Merge(Data1=element_2, Data2=element)
dispatch_2 = Dispatch(List=samcore_getwalls, DispatchPattern=larger_2.LargerThan)  # -> ListA, ListB
panel = Panel(element_passport.Id)
panel_2 = Panel("""776319
841820""")
entwine = Entwine(Branch00=dispatch_2.ListA, Branch01=dispatch.ListA, FlattenInputs=True)  # -> simplify(Result)
integer = Integer(panel_2)
partition = PartitionList(List=integer, Size=1)  # -> simplify(Chunks)
samcore_tagelements = SAMCoreTagElements(
    _templateNames="Heating Load",
    _tagType=partition,
    _elements=entwine,
    _addLeader_=False,
    _horizontal_=True,
    _viewTypes_="FloorPlan",
    _run=Toggle(True),
    SAM_ComponentVersion="1.0.1")
panel_3 = Panel(entwine)
param_viewer = ParamViewer(entwine)
