# Grasshopper definition R3.TagWalls_ver00.ghx (Grasshopper 1.0.7)
# plug-ins: SAM.Core.Grasshopper.Revit, Rhino.Inside for Autodesk Revit

anno_tag_sam_curtainwall = ElementTypePicker({"Anno_Tag_SAM_CurtainWall  : Standard": "00933d1d-33cb-4c93-9878-e180c2019448-6c0b39d8-0d37-4f43-8941-b826f64e1f9c-000cd85c"}, selected="Anno_Tag_SAM_CurtainWall  : Standard")

# ---- group: Not Curtain Walls
sam_core_wallkind = SAMCoreWallKind(WallKind=1, SAM_ComponentVersion="1.0.0", SAM_SAMVersion="v20210215.1")
samcore_getwalls = SAMCoreGetWalls(_wallKinds=sam_core_wallkind, _inverted=Toggle(True), SAM_ComponentVersion="1.0.0", SAM_SAMVersion="v20210215.1")

# ----
anno_tag_sam_wall = ElementTypePicker({"Anno_Tag_SAM_Wall  : Standard": "00933d1d-33cb-4c93-9878-e180c2019448-85bd20c8-aefd-4e77-9d94-d5590b09affa-000bd87f"}, selected="Anno_Tag_SAM_Wall  : Standard")

# ---- group: Curtain
sam_core_wallkind_2 = SAMCoreWallKind(WallKind=1, SAM_ComponentVersion="1.0.0", SAM_SAMVersion="v20210215.1")
samcore_getwalls_2 = SAMCoreGetWalls(_wallKinds=sam_core_wallkind_2, _inverted=False, SAM_ComponentVersion="1.0.0", SAM_SAMVersion="v20210215.1")

# ----
number_slider = Slider(1, range=0..1)
_1_5_m_min_lentgt_for_tag = Panel("1.5")
getparam = GetElementParameter(Element=samcore_getwalls_2, ParameterKey="Length")
getparam_2 = GetElementParameter(Element=samcore_getwalls, ParameterKey="Length")
element = Element(anno_tag_sam_wall)
element_2 = Element(anno_tag_sam_curtainwall)
element_passport = ElementPassport(Element=[element_2, element])  # -> DocumentGUID, Document, UniqueID, Id
larger = LargerThan(FirstNumber=getparam, SecondNumber=_1_5_m_min_lentgt_for_tag)  # -> LargerThan, OrEqualTo
larger_2 = LargerThan(FirstNumber=getparam_2, SecondNumber=_1_5_m_min_lentgt_for_tag)  # -> LargerThan, OrEqualTo
panel = Panel(element_passport.Id)
merge = Merge(Data1=element_2, Data2=element)
dispatch = Dispatch(List=samcore_getwalls_2, DispatchPattern=larger.LargerThan)  # -> ListA, ListB
dispatch_2 = Dispatch(List=samcore_getwalls, DispatchPattern=larger_2.LargerThan)  # -> ListA, ListB
panel_2 = Panel("""841820
776319""")
tstat = TreeStatistics(Tree=dispatch.ListA)  # -> Paths, flatten(Length), Count
tstat_2 = TreeStatistics(Tree=dispatch_2.ListA)  # -> Paths, flatten(Length), Count
flatten = FlattenTree(Tree=dispatch_2.ListA, Path="0")
flatten_2 = FlattenTree(Tree=dispatch.ListA, Path="1")
partition = PartitionList(List=flatten, Size=tstat_2.Length)
partition_2 = PartitionList(List=flatten_2, Size=tstat.Length)
integer = Integer(panel_2)
merge_2 = Merge(Data1=partition, Data2=partition_2)
partition_3 = PartitionList(List=integer, Size=1)
samcore_tagelements = SAMCoreTagElements(
    _templateNames=flatten("Heating Load"),
    _tagType=partition_3,
    _elements=merge_2,
    _addLeader_=False,
    _horizontal_=True,
    _viewTypes_="FloorPlan",
    _run=Toggle(True),
    SAM_ComponentVersion="1.0.0",
    SAM_SAMVersion="v20210215.1")
panel_3 = Panel(samcore_tagelements)
