# Grasshopper definition R0.CleanSAM-Template-ver02.ghx (Grasshopper 1.0.8)
# plug-ins: Rhino.Inside for Autodesk Revit, SAM.Core.Grasshopper.Revit

annotation = AnnotationCategoriesPicker({"Adaptive Points": -2000900, "Alignment Station Label Sets": -2001016, "Alignment Station Labels": -2001017, "Alignments": -2001012, "Annotation Crop Boundary": -2000547, "Brace in Plan View Symbols": -2006110, "Callout Boundary": -2000539, "Callouts": -2000537, "Cameras": -2000501, "Color Fill Legends": -2000550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}, selected="Levels": -2000240)
annotation_2 = AnnotationCategoriesPicker({"Adaptive Points": -2000900, "Alignment Station Label Sets": -2001016, "Alignment Station Labels": -2001017, "Alignments": -2001012, "Annotation Crop Boundary": -2000547, "Brace in Plan View Symbols": -2006110, "Callout Boundary": -2000539, "Callouts": -2000537, "Cameras": -2000501, "Color Fill Legends": -2000550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}, selected="Reference Planes": -2000530)
model = ModelCategoriesPicker({"Abutments": -2006130, "Air Systems": -2001008, "Air Terminals": -2008013, "Analysis Display Style": -2000304, "Analysis Results": -2000303, "Areas": -2003200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}, selected="Generic Models": -2000151)
model_2 = ModelCategoriesPicker({"Abutments": -2006130, "Air Systems": -2001008, "Air Terminals": -2008013, "Analysis Display Style": -2000304, "Analysis Results": -2000303, "Areas": -2003200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}, selected="Lines": -2000051)
model_3 = ModelCategoriesPicker({"Abutments": -2006130, "Air Systems": -2001008, "Air Terminals": -2008013, "Analysis Display Style": -2000304, "Analysis Results": -2000303, "Areas": -2003200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}, selected="Walls": -2000011)
model_4 = ModelCategoriesPicker({"Abutments": -2006130, "Air Systems": -2001008, "Air Terminals": -2008013, "Analysis Display Style": -2000304, "Analysis Results": -2000303, "Areas": -2003200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}, selected="Spaces": -2003600)
model_5 = ModelCategoriesPicker({"Abutments": -2006130, "Air Systems": -2001008, "Air Terminals": -2008013, "Analysis Display Style": -2000304, "Analysis Results": -2000303, "Areas": -2003200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}, selected="Floors": -2000032)
model_6 = ModelCategoriesPicker({"Abutments": -2006130, "Air Systems": -2001008, "Air Terminals": -2008013, "Analysis Display Style": -2000304, "Analysis Results": -2000303, "Areas": -2003200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}, selected="Roofs": -2000035)
merge = Merge(Data1=model_3, Data2=model_5, Data3=model_6, Data4=model_4, Data5=model_2, Data6=model, Data7=annotation)
category_filter = CategoryFilter(Categories=merge, Inverted=False)
query_elements = QueryElements(Filter=category_filter)  # -> Elements, Count

# ----
# Items to keep
level_01 = Panel("694")
level_00 = Panel("311")
integer = Integer(flatten(level_00))

element_passport = ElementPassport(Element=query_elements.Elements)  # -> DocumentGUID, Document, UniqueID, Id
integer_2 = Integer(element_passport.Id)
integer_3 = Integer(element_passport.Id)
member_index = MemberIndex(Set=integer_2, Member=integer)  # -> flatten(Index), Count
panel = Panel("1053264")
cull_index = CullIndex(List=query_elements.Elements, Indices=member_index.Index, Wrap=True)
button = Button()
samcore_deleteelement = SAMCoreDeleteElement(_elements=cull_index, _run=Toggle(True), SAM_ComponentVersion="1.0.1")
panel_2 = Panel(samcore_deleteelement)
