# Grasshopper definition R2.Create-Sheets-Dependat-Views-ver02.ghx (Grasshopper 1.0.8)
# plug-ins: Rhino.Inside for Autodesk Revit, SAM.Core.Grasshopper.Revit

panel = Panel("""Cooling Load
Heating Load""")
a0_template = Panel("725533")
a1_template = Panel("725518")
integer = Integer(a0_template)
query_element = QueryElement(Id=integer)
panel_2 = Panel(query_element)
samcore_createsheets = SAMCoreCreateSheets(
    _referenceViewSheet=query_element,
    _templateNames=panel,
    _matchScopeBox_=Toggle(True),
    _run=Toggle(True),
    SAM_ComponentVersion="1.0.1")
element_name = ElementName(Element=samcore_createsheets)  # -> Element, Name
panel_3 = Panel(element_name.Name)
