# Grasshopper definition R4.TagWindows-ver01.ghx (Grasshopper 1.0.7)
# plug-ins: SAM.Core.Grasshopper.Revit, Rhino.Inside for Autodesk Revit

# ---- group: Not Curtain Walls
toggle = BooleanToggle(False)  # disabled
sam_core_wallkind = SAMCoreWallKind(WallKind=1, SAM_ComponentVersion="1.0.0", SAM_SAMVersion="v20210215.1")  # disabled
samcore_getwalls = SAMCoreGetWalls(_wallKinds=sam_core_wallkind, _inverted=toggle, SAM_ComponentVersion="1.0.0", SAM_SAMVersion="v20210215.1")  # disabled

# ---- group: Curtain
sam_core_wallkind_2 = SAMCoreWallKind(WallKind=1, SAM_ComponentVersion="1.0.0", SAM_SAMVersion="v20210215.1")  # disabled
samcore_getwalls_2 = SAMCoreGetWalls(_wallKinds=sam_core_wallkind_2, _inverted=False, SAM_ComponentVersion="1.0.0", SAM_SAMVersion="v20210215.1")  # disabled

# ----
component_families_picker = ComponentFamiliesPicker(<component families picker referenced from the Revit model>, SearchPattern="Window")
component_families_picker_2 = ComponentFamiliesPicker(<component families picker referenced from the Revit model>, SearchPattern="Door")
number_slider = Slider(1, range=0..1)
_1_5_m_min_lentgt_for_tag = Panel("1.5")
anno_tag_sam_curtainwall = ElementTypePicker({"Anno_Tag_SAM_CurtainWall : Standard": "00933d1d-33cb-4c93-9878-e180c2019448-6c0b39d8-0d37-4f43-8941-b826f64e1f9c-000cd85c"}, selected="Anno_Tag_SAM_CurtainWall : Standard")
getparam = GetElementParameter(Element=samcore_getwalls_2, ParameterKey="Length")
anno_tag_sam_wall = ElementTypePicker({"Anno_Tag_SAM_Wall : Standard": "00933d1d-33cb-4c93-9878-e180c2019448-85bd20c8-aefd-4e77-9d94-d5590b09affa-000bd87f"}, selected="Anno_Tag_SAM_Wall : Standard")
getparam_2 = GetElementParameter(Element=samcore_getwalls, ParameterKey="Length")
anno_tag_sam_window = ElementTypePicker({"Anno_Tag_SAM_Window : Standard": "00933d1d-33cb-4c93-9878-e180c2019448-85bd20c8-aefd-4e77-9d94-d5590b09affa-000bd3c9"}, selected="Anno_Tag_SAM_Window : Standard")
anno_tag_sam_door = ElementTypePicker({"Anno_Tag_SAM_Door : Standard": "00933d1d-33cb-4c93-9878-e180c2019448-85bd20c8-aefd-4e77-9d94-d5590b09affa-000bd4b7"}, selected="Anno_Tag_SAM_Door : Standard")
panel = Panel(component_families_picker)
larger = LargerThan(FirstNumber=getparam, SecondNumber=_1_5_m_min_lentgt_for_tag)  # -> LargerThan, OrEqualTo
category = Category(<category referenced from the Revit model>)
larger_2 = LargerThan(FirstNumber=getparam_2, SecondNumber=_1_5_m_min_lentgt_for_tag)  # -> LargerThan, OrEqualTo
category_filter = CategoryFilter(Categories=category, Inverted=False)
category_2 = Category(<category referenced from the Revit model>)
element = Element(anno_tag_sam_wall)
element_2 = Element(anno_tag_sam_curtainwall)
category_filter_2 = CategoryFilter(Categories=category_2, Inverted=False)
query_elements = QueryElements(Filter=category_filter, Limit=100)  # -> Elements, Count
merge = Merge(Data1=element_2, Data2=element)
dispatch = Dispatch(List=samcore_getwalls, DispatchPattern=larger_2.LargerThan)  # -> ListA, ListB
element_passport = ElementPassport(Element=anno_tag_sam_door)  # -> DocumentGUID, Document, UniqueID, Id
query_elements_2 = QueryElements(Filter=category_filter_2, Limit=100)  # -> Elements, Count
dispatch_2 = Dispatch(List=samcore_getwalls_2, DispatchPattern=larger.LargerThan)  # -> ListA, ListB
panel_2 = Panel("""775113
775351""")
panel_3 = Panel("1131535")
toggle_2 = BooleanToggle(False)
integer = Integer(panel_2)
entwine = Entwine(Branch00=query_elements.Elements, Branch01=query_elements_2.Elements, FlattenInputs=True)  # -> simplify(Result)
partition = PartitionList(List=integer, Size=1)  # -> simplify(Chunks)
panel_4 = Panel(entwine)
param_viewer = ParamViewer(entwine)
samcore_tagelements = SAMCoreTagElements(
    _templateNames="Heating Load",
    _tagType=partition,
    _elements=entwine,
    _addLeader_=False,
    _horizontal_=True,
    _viewTypes_="FloorPlan",
    _run=Toggle(True),
    SAM_ComponentVersion="1.0.1")
