# Grasshopper definition R5.AddSpace-Tags-ver01.ghx (Grasshopper 1.0.7)
# plug-ins: Rhino.Inside for Autodesk Revit, SAM.Core.Grasshopper.Revit

panel = Panel("""RiserCLG
RiserHTG
RiserVNT
ICType
RefExhaust
RefSupply
SAM Model
NoPeople
Heating Load
Cooling Load""")
panel_2 = Panel("""1107209
1107209
1107209
1107211
1107215
1107215
1107203
1107213
1107219
1107217""")
query_element = QueryElement(Id=panel_2)
graft_tree = GraftTree(Tree=panel, IncludeEmptyLists=True, IncludeNullItems=True)  # -> simplify(Tree)
graft_tree_2 = GraftTree(Tree=query_element, IncludeEmptyLists=True, IncludeNullItems=True)  # -> simplify(Tree)
# View Templates: 00_Reference
# 01_Spaces Colour Scheme
# 01_Spaces-Floorplan
# CIBSE 2006 Overheating (25C)
# CIBSE 2006 Overheating (28C)
# CIBSE 2006 Overheating DSY1
# CIBSE 2006 Overheating DSY2
# CIBSE 2006 Overheating DSY3
# Comfort PPD
# Cooling Load
# D - ColourScheme
# D - Spaces
# Daylight
# Glazed walls Check
# Heating Load
# IC and Envelope
# ICType
# IZAM Supply
# NCM Lighting
# NCM Space Type
# NCM System
# NCM_IC
# NCM_System
# NoPeople
# RefExhaust
# RefSupply
# RiserCLG
# RiserHTG
# RiserVNT
# SAM Model
# Summer Design Temp
# TM52
# TM52 DSY1
# TM52 DSY2
# TM52 DSY3
# TM52Future
# TM54
# TypeCLG
# TypeEnvironmentalStrategy
# TypeHTG
# TypeLUX
# TypeVNT
# Winter Design Temp
# ZoneCLG
# ZoneHTG
# ZoneVNT
# Space Tags Name: Assumptions
# CIBSE 2006 Overheating
# CIBSE 2006 Overheating DSY1
# CIBSE 2006 Overheating DSY2
# CIBSE 2006 Overheating DSY3
# Comfort
# Daylight
# HeatLoss
# IC Type
# ICType Envelope
# Lighting
# Lighting LUX
# LightingNCM
# Load
# NCM_IC
# NCM_System
# No People
# Ref AHU
# Results
# Riser
# SmallPower_Data
# Space Tag
# TM52
# TM52 DSY1
# TM52 DSY2
# TM52 DSY3
# TM52 Future
# TM54
space_tag_element_ids = Panel("""1107207
1107241
1107235
1107237
1107239
1107257
1107255
1107219
1107211
1107243
1107227
1107233
1107221
1107217
1107231
1107229
1107213
1107215
1107205
1107209
1107225
1107203
1107251
1107245
1107247
1107249
1107253
1107223""")
samcore_tagspaces = SAMCoreTagSpaces(
    _templateNames=graft_tree,
    _spaceTagType=graft_tree_2,
    _viewTypes_="FloorPlan",
    _run=Toggle(True),
    SAM_ComponentVersion="1.0.1")
panel_3 = Panel(samcore_tagspaces)
param_viewer = ParamViewer(samcore_tagspaces)
